# Grasshopper definition Clustering.gh (Grasshopper 1.0.7)
# plug-ins: MetaHopper, EF - R7 Beta, Human

gallery = ImageGallery(CycleDelay=30, Randomize=False, UseLocalImages=True, UseRemoteImages=True)

# ---- group: Input CSV's
panel = Panel("""Building_Program.csv
Cluster_Program.csv""")

# ----
# #1 Pick the appropriate
# CSV Data
list = ItemSelector(panel, {"Building_Program.csv", "Cluster_Program.csv"}, selected="Cluster_Program.csv")
suirify = Suirify()

bake_text = BooleanToggle(True)
# floor height for the large clusters is set to 1m
# Tip: Use Grid snap on a 1m grid
# #3 When Finished Bake the result
# subversion names are automatically updated
button = Button()

hnr = ColourSwatch(SwatchColor=RGBA(255, 0, 0, 166))
dac = ColourSwatch(SwatchColor=RGBA(74, 192, 255, 155))
gen = ColourSwatch(SwatchColor=RGBA(178, 178, 178, 188))
# Optionally change colors
alg = ColourSwatch(SwatchColor=RGBA(124, 198, 107, 185))
off = ColourSwatch(SwatchColor=RGBA(0, 0, 255, 157))
res = ColourSwatch(SwatchColor=RGBA(255, 255, 0, 176))
dic = ColourSwatch(SwatchColor=RGBA(140, 81, 93, 157))
entwine = Entwine(Branch00=alg, Branch01=dic, Branch02=dac, Branch03=hnr, Branch04=res, Branch05=off, Branch06=gen, FlattenInputs=True)  # -> flatten(Result)

# ---- group: Get input curves
pipeline = GeometryPipeline(
    GroupByLayer=False,
    GroupByType=False,
    IncludeHidden=True,
    IncludeLocked=True,
    LayerFilter="Base_Curve",
    NameFilter="*",
    SublayerFiltering=True,
    TypeFilter=4)
panel_2 = Panel("""Cluster
Function""")
panel_3 = Panel("Floors")
crv = Curve(pipeline)
getuv = GetUserValue(Geometry=crv, Key=panel_2)
getuv_2 = GetUserValue(Geometry=crv, Key=panel_3)
case = TextCase(Text=getuv, Culture=127)  # -> UpperCase, LowerCase
flip = FlipMatrix(Data=case.UpperCase)  # -> simplify(Data)
bang = ExplodeTree(Data=flip)  # -> Branch0, Branch1
concat = Concatenate(FragmentA=bang.Branch0, FragmentB=" / ", FragmentC=bang.Branch1)

# ---- group: Get input CSV
# The excel cannot be opened during script operation
relpath = RelativePath(Path=list)
file = ReadFile(File=relpath, PerLineParse=True)
split = TextSplit(Text=file, Separators=";")
case_2 = TextCase(Text=split, Culture=127)  # -> UpperCase, LowerCase
flip_2 = FlipMatrix(Data=case_2.UpperCase)
cull_i = CullIndex(List=flip_2, Indices=0, Wrap=True)  # -> simplify(List)
bang_2 = ExplodeTree(Data=cull_i)  # -> Branch0, Branch1, Branch2, Branch3, Branch4, Branch5

# ---- group: Initialise Curves
initial_line_length = Slider(40, range=0..100)
xy = XYPlane(Origin=Point(0, 0, 0))
X = UnitX(Factor=1)
line = LineSDL(Start=xy, Direction=X, Length=initial_line_length)
addition = Addition(A=initial_line_length, B=10)
txt = Text(panel_2)
txt_2 = Text(panel_3)
txt_3 = Text(bang_2.Branch0)
txt_4 = Text(bang_2.Branch1)
entwine_2 = Entwine(Branch00=txt, Branch01=txt_2, FlattenInputs=True)  # -> flatten(Result)
X_2 = UnitX(Factor=addition)
lng = ListLength(List=txt_4)
arrlinear = LinearArray(Geometry=line, Direction=X_2, Count=lng)  # -> Geometry, Transform
dup = DuplicateData(Data=1, Number=lng, Order=True)
lng_2 = ListLength(List=entwine_2)
entwine_3 = Entwine(Branch00=txt_3, Branch01=txt_4, Branch02=dup, FlattenInputs=True)
dup_2 = DuplicateData(Data=entwine_2, Number=lng, Order=True)
flip_3 = FlipMatrix(Data=entwine_3)
partition = PartitionList(List=dup_2, Size=lng_2)
bake_name = Panel("Base_Bake")
attributes = DefineObjectAttributes(UserKeys=partition, UserValues=flip_3, Layer="Base_Curve")  # -> flatten(Attributes)

# ----
# #2 Initialize the Base Curves
# or reset the Canvas
bake = BakeObjects(Geometry=arrlinear.Geometry, Attributes=attributes, BakeName=bake_name)  # -> Message, Guids
# In Rhino select the curves and change the amount of floors
# under properties -> attribute user text
suirify_2 = Suirify()

concat_2 = Concatenate(FragmentA=bang_2.Branch0, FragmentB=" / ", FragmentC=bang_2.Branch1)
txt_5 = Text(bang_2.Branch0)
mindex = MemberIndex(Set=concat_2, Member=concat)  # -> flatten(Index), Count

# ---- group: Data comb & Sort
# Area
# Height
# Name
# Curves
# Floors
item = ListItem(List=bang_2.Branch3, Index=mindex.Index, Wrap=True)
item_2 = ListItem(List=bang_2.Branch2, Index=mindex.Index, Wrap=True)
crv_2 = Curve(crv)
txt_6 = Text(concat)
int = Integer(getuv_2)

# ---- group: Options
txt_7 = Text(concat_2)
panel_4 = Panel(txt_7)

# ----
sort = SortList(Keys=mindex.Index, ValuesA=item_2, ValuesB=item, ValuesC=txt_6, ValuesD=crv_2, ValuesE=int)  # -> Keys, ValuesA, ValuesB, ValuesC, ValuesD, ValuesE

# ---- group: Name & Split amount
cset = CreateSet(List=sort.ValuesC)  # -> Set, Map
mindex_2 = MemberIndex(Set=cset.Map, Member=cset.Map)  # -> Index, Count
python = GhPythonScript(x=cset.Map)  # -> a; inputs x: list
# ---------- python: Python ----------
__author__ = "jirri"
__version__ = "2022.04.23"

last = 9
output = 1
a = []
for i in x:
    if i == last:
        output += 1
    else:
        output = 1
    a.append(output)
    last = i
# ---------- end python ----------
lng_3 = ListLength(List=mindex_2.Index)  # -> flatten(Length)
concat_3 = Concatenate(FragmentA=sort.ValuesC, FragmentB=" - ", FragmentC=python, FragmentD="/", FragmentE=lng_3)
panel_5 = Panel(concat_3)

# ---- group: Height & Floors
multiplication = Multiplication(A=sort.ValuesB, B=sort.ValuesE)
division = Division(A=sort.ValuesA, B=lng_3)
division_2 = Division(A=division, B=sort.ValuesE)

# ----
txt_8 = Text(["MetaHopper, Version=1.2.1.0, Culture=neutral, PublicKeyToken=null", "EleFront_Beta, Version=5.0.0.0, Culture=neutral, PublicKeyToken=null", "Human, Version=1.7.3.0, Culture=neutral, PublicKeyToken=null"])

docinfo = DocumentInfo(AutoUpdate=False, Recursive=False)  # -> DocumentName, DocumentFilePath, Components, Params, _3rdPartyAssemblies; disabled
panel_6 = Panel(txt_8)

# ---- group: Box generation
num = Number(division_2)
num_2 = Number(multiplication)
crv_3 = Curve(sort.ValuesD)
end = EndPoints(Curve=crv_3)  # -> Start, End
vec2pt = Vector2Pt(PointA=end.Start, PointB=end.End, Unitize=False)  # -> Vector, Length
len = Length(Curve=crv_3)
division_3 = Division(A=num, B=len)
pl = ConstructPlane(Origin=end.Start, XAxis=vec2pt.Vector, YAxis=Vector(0, 1, 0))
box = DomainBox(Base=pl, X=len, Y=division_3, Z=num_2)
volume = Volume(Geometry=box, UseTasks=False)  # -> Volume, Centroid

# ---- group: Category Color finding
txt_9 = Text(txt_5)
python_2 = GhPythonScript(x=panel_5)  # -> a, b; inputs x: list
# ---------- python_2: Python ----------
__author__ = "jirri"
__version__ = "2022.04.23"

a=[]
b=[]
for i in x:
    a.append(i[0:3])
    b_temp = i[6:]
    b.append(b_temp[:-6])
# ---------- end python_2 ----------
cset_2 = CreateSet(List=txt_9)  # -> Set, Map
mindex_3 = MemberIndex(Set=cset_2.Set, Member=python_2.a)  # -> flatten(Index), Count
col = Colour(entwine)
item_3 = ListItem(List=col, Index=mindex_3.Index, Wrap=True)

# ---- group: Display
tag = TextTag(Location=volume.Centroid, Text=panel_5, Colour=ColourSwatch(SwatchColor=RGB(0, 0, 0)))
preview = CustomPreview(Geometry=box, Material=item_3)

# ---- group: Bake Geometry
txt_10 = Text("Bake Version 1.")
bool = Boolean(button)
geo = Geometry(box)
python_3 = GhPythonScript(name=txt_10, activate=bool)  # -> layer_current
# ---------- python_3: Python ----------
__author__ = "jirri"
__version__ = "2022.04.25"

from rhinoscriptsyntax import LayerNames as ln
import scriptcontext as sc
from Rhino import RhinoDoc as rd
sc.doc = rd.ActiveDoc
layer_names = ln()
layer_index=[]
name_len = len(name)
for i in layer_names:
    if i[0:name_len] == name:
        layer_index.append(int(i[name_len]))

if len(layer_index) == 0:
    layer_current = 1
else:
    layer_current = max(layer_index) + 1

print(layer_current)
# ---------- end python_3 ----------
lng_4 = ListLength(List=geo)
txt_11 = Text(panel_2)
txt_12 = Text(panel_3)
txt_13 = Text(python_2.a)
int_2 = Integer(sort.ValuesE)
txt_14 = Text(python_2.b)
entwine_4 = Entwine(Branch00=txt_11, Branch01=txt_12, FlattenInputs=True)  # -> flatten(Result)
entwine_5 = Entwine(Branch00=txt_13, Branch01=txt_14, Branch02=int_2, FlattenInputs=True)
concat_4 = Concatenate(FragmentA=txt_10, FragmentC=python_3)
dup_3 = DuplicateData(Data=entwine_4, Number=lng_4, Order=True)
lng_5 = ListLength(List=entwine_4)
gate = StreamGate(Stream=concat_4, Gate=bool)  # -> Target0, Target1
partition_2 = PartitionList(List=dup_3, Size=lng_5)
flip_4 = FlipMatrix(Data=entwine_5)
layers = CreateModifyLayers(LayerName=gate.Target1, DeleteLayer=False, enableFullPath=True)  # -> LayerNames, LayerFullPath
col_2 = Colour(item_3)
createatts = CreateAttributes(LayerName=layers.LayerNames, Color=graft(col_2), UserDataKeys=partition_2, UserDataValues=flip_4, enableFullPath=True)
bake_2 = BakeGeometry(Bake=bool, Geometry=graft(geo), Attributes=createatts, DeleteOldBakes=False, PreserveTrees=False)

# ---- group: bake text
concat_5 = Concatenate(FragmentA=gate.Target1, FragmentB="::text")
gate_2 = StreamGate(Stream=concat_5, Gate=bool)  # -> Target0, Target1
bool_2 = Boolean(bake_text)
layers_2 = CreateModifyLayers(LayerName=gate_2.Target1, DeleteLayer=False, enableFullPath=True)  # -> LayerNames, LayerFullPath
gate_3 = StreamGate(Stream=bool, Gate=bool_2)  # -> Target0, Target1
createatts_2 = CreateAttributes(LayerName=layers_2.LayerFullPath, enableFullPath=True)
bake_3 = BakeObject(ObjectAttributes=createatts_2, Bake=gate_3.Target1, AllObjects_Object=tag)
